# Dynamo graph project_ic_profiles.dyn (Dynamo 3.3.1.7726)

# group: Main
string = StringInput("Combined Paste")
duckdb_path = StringInput("\\wsl.localhost\Ubuntu-24.04\home\wsl\work\project\dynamo-python-node-docs-v1\data\stage3_crossings.ddb")
pv_parts_gravity_style_name = StringInput("Pipe Crossing Pipe (Storm)")
pressure_pipe_name_to_copy_style = StringInput("ME_Pressure Network_(490)")  # "Pressure Pipe Name to Copy Style From"
reload_tocken = IntegerSlider(35, range=0..100 step 1)
python_script = Python(IN[0]=duckdb_path, IN[1]=pv_parts_gravity_style_name, IN[2]=pressure_pipe_name_to_copy_style, IN[3]=reload_tocken)  # CPython3; frozen
# ---------- python_script.python (50 lines) ----------
import sys, clr, importlib, traceback

clr.AddReference("AcMgd"); clr.AddReference("AcCoreMgd"); clr.AddReference("AcDbMgd")
clr.AddReference("AecBaseMgd"); clr.AddReference("AecPropDataMgd"); clr.AddReference("AeccDbMgd")
 
from Autodesk.AutoCAD.ApplicationServices.Core import Application
from Autodesk.Civil.ApplicationServices import CivilApplication

# --- repo path (edit to your clone) ---
REPO = r"\\wsl.localhost\Ubuntu-24.04\home\wsl\work\project\dynamo-python-node-docs-v1"
if REPO not in sys.path:
    sys.path.insert(0, REPO)
if f"{REPO}/Site-packages" not in sys.path:
    sys.path.append(f"{REPO}/Site-packages")

def unload_package(package_name):
    for name in list(sys.modules.keys()):
        if name == package_name or name.startswith(package_name + "."):
            del sys.modules[name]

# --- active document context ---
doc    = Application.DocumentManager.MdiActiveDocument
db     = doc.Database
ed     = doc.Editor
civdoc = CivilApplication.ActiveDocument

results = {"Success": False, "Warnings": [], "Errors": [], "Skipped": [], "Data": None}
RAISE_ON_ERROR = False

try:
    importlib.invalidate_caches()
    unload_package("automations")                                  # drop cached modules
    mod = importlib.import_module("automations.stage6_add_parts")

    with doc.LockDocument():
        with db.TransactionManager.StartTransaction() as tr:
            context = {"doc": doc, "db": db, "ed": ed,
                       "civdoc": civdoc, "tr": tr, "IN": IN}
            results["Data"] = mod.run(context)                     # module does the work
            tr.Commit()

    results["Success"] = True
    results["ModuleFile"] = getattr(mod, "__file__", None)         # confirms which file ran
except Exception as ex:
    results["Errors"].append(str(ex))
    results["Traceback"] = traceback.format_exc()
    if RAISE_ON_ERROR:
        raise

OUT = results
# ----------------------------------------
watch = Watch(python_script)

python_script_2 = Python()  # CPython3; frozen; unwired: IN[0]
# ---------- python_script_2.python (54 lines) ----------
# Find the PressurePipeStyle collection. OUT = report
import clr
clr.AddReference("AcMgd"); clr.AddReference("AcDbMgd"); clr.AddReference("AeccDbMgd")
clr.AddReference("AeccPressurePipesMgd")
from Autodesk.AutoCAD.ApplicationServices.Core import Application
from Autodesk.AutoCAD.DatabaseServices import OpenMode
from Autodesk.Civil.ApplicationServices import CivilApplication, CivilDocumentPressurePipesExtension
civdoc = CivilApplication.ActiveDocument
db = Application.DocumentManager.MdiActiveDocument.Database
report = []
def log(x): report.append(str(x))

# (1) full recursive-ish walk of civdoc.Styles for ANY collection whose ToObjectIds
#     yields a PressurePipeStyle, one level under each *Styles collection too
tr = db.TransactionManager.StartTransaction()
try:
    nids = list(CivilDocumentPressurePipesExtension.GetPressurePipeNetworkIds(civdoc))
    pp = None
    for nid in nids:
        pids = list(tr.GetObject(nid, OpenMode.ForRead).GetPipeIds())
        if pids: pp = tr.GetObject(pids[0], OpenMode.ForRead); break
    target = str(pp.get_StyleId())
    log(f"target = {target}")

    styles = civdoc.Styles
    roots = [n for n in dir(styles) if n.endswith("Styles") and not n.startswith("get_")]
    for cn in roots:
        coll = getattr(styles, cn, None)
        # try the collection itself
        try:
            oids = list(coll.ToObjectIds())
            if any(str(o)==target for o in oids):
                log(f">>> target in civdoc.Styles.{cn}")
            # peek element type
            if oids:
                t = type(tr.GetObject(oids[0], OpenMode.ForRead)).__name__
                if "Pressure" in t:
                    log(f"civdoc.Styles.{cn} holds {t} (Count={len(oids)})")
        except Exception:
            pass
        # try nested sub-collections one level down
        for sub in [s for s in dir(coll) if s.endswith("Styles") and not s.startswith("get_")]:
            try:
                subcoll = getattr(coll, sub)
                oids = list(subcoll.ToObjectIds())
                if any(str(o)==target for o in oids):
                    log(f">>> target in civdoc.Styles.{cn}.{sub}")
                if oids and "Pressure" in type(tr.GetObject(oids[0], OpenMode.ForRead)).__name__:
                    log(f"civdoc.Styles.{cn}.{sub} holds PressurePipeStyle (Count={len(oids)})")
            except Exception:
                pass
finally:
    tr.Dispose()
OUT = report
# ----------------------------------------
watch_2 = Watch(python_script_2)
code_block = CodeBlock(x=watch) { x["Data"]["Handoff"]; }
watch_3 = Watch(code_block)
code_block_2 = CodeBlock { "LV CROSSING"; }
code_block_3 = CodeBlock { "WATER CROSSING"; }
integer_slider = IntegerSlider(52, range=0..100 step 1)
python_script_3 = Python(IN[0]=duckdb_path, IN[1]=code_block_2, IN[2]=code_block_3, IN[3]=code_block, IN[4]=integer_slider)  # CPython3
# ---------- python_script_3.python (50 lines) ----------
import sys, clr, importlib, traceback

clr.AddReference("AcMgd"); clr.AddReference("AcCoreMgd"); clr.AddReference("AcDbMgd")
clr.AddReference("AecBaseMgd"); clr.AddReference("AecPropDataMgd"); clr.AddReference("AeccDbMgd")
 
from Autodesk.AutoCAD.ApplicationServices.Core import Application
from Autodesk.Civil.ApplicationServices import CivilApplication

# --- repo path (edit to your clone) ---
REPO = r"\\wsl.localhost\Ubuntu-24.04\home\wsl\work\project\dynamo-python-node-docs-v1"
if REPO not in sys.path:
    sys.path.insert(0, REPO)
if f"{REPO}/Site-packages" not in sys.path:
    sys.path.append(f"{REPO}/Site-packages")

def unload_package(package_name):
    for name in list(sys.modules.keys()):
        if name == package_name or name.startswith(package_name + "."):
            del sys.modules[name]

# --- active document context ---
doc    = Application.DocumentManager.MdiActiveDocument
db     = doc.Database
ed     = doc.Editor
civdoc = CivilApplication.ActiveDocument

results = {"Success": False, "Warnings": [], "Errors": [], "Skipped": [], "Data": None}
RAISE_ON_ERROR = False

try:
    importlib.invalidate_caches()
    unload_package("automations")                                  # drop cached modules
    mod = importlib.import_module("automations.stage7_labels")

    with doc.LockDocument():
        with db.TransactionManager.StartTransaction() as tr:
            context = {"doc": doc, "db": db, "ed": ed,
                       "civdoc": civdoc, "tr": tr, "IN": IN}
            results["Data"] = mod.run(context)                     # module does the work
            tr.Commit()

    results["Success"] = True
    results["ModuleFile"] = getattr(mod, "__file__", None)         # confirms which file ran
except Exception as ex:
    results["Errors"].append(str(ex))
    results["Traceback"] = traceback.format_exc()
    if RAISE_ON_ERROR:
        raise

OUT = results
# ----------------------------------------
watch_4 = Watch(python_script_3)

# group: Test one crossing in modelspace
code_block_4 = CodeBlock { x["Data"]["Crossings"][4792]; }  # frozen; unwired: x
watch_5 = Watch(code_block_4)
code_block_5 = CodeBlock(x=code_block_4) { x[7]; x[8]; x[9]; }
byCoordinates = Point.ByCoordinates(x=code_block_5.out0, y=code_block_5.out1, z=code_block_5.out2)
watch_6 = Watch(byCoordinates)
integer_slider_2 = IntegerSlider(63, range=0..100 step 1)
byCenterPointRadius = Circle.ByCenterPointRadius(centerPoint=byCoordinates, radius=integer_slider_2)
watch_7 = Watch(byCenterPointRadius)
string_2 = StringInput("Testing")
byGeometry = Autodesk.AutoCAD.DynamoNodes.Object.ByGeometry(geometry=byCoordinates, layerName=string_2)
watch_8 = Watch(byGeometry)
string_3 = StringInput("Testing")
byGeometry_2 = Autodesk.AutoCAD.DynamoNodes.Object.ByGeometry(geometry=byCenterPointRadius, layerName=string_3)
watch_9 = Watch(byGeometry_2)
code_block_6 = CodeBlock(x=watch_4) { x["Data"]["Warnings"]; }

code_block_7 = CodeBlock(x=watch_4) { x["Data"]["Warnings"]; }
watch_10 = Watch(code_block_7)
watch_11 = Watch(code_block_6)
string_4 = StringInput("\\wsl.localhost\Ubuntu-24.04\home\wsl\work\project\dynamo-python-node-docs-v1\data\20260717_crossings.ddb")
python_script_4 = Python(IN[0]=string_4)  # CPython3; frozen
# ---------- python_script_4.python (129 lines) ----------
# Probe: inspect ProfileViewPart / label-like entities around PIPE-10 PVs.
# No IN required.

import traceback
import clr

from Autodesk.AutoCAD.ApplicationServices import Application
from Autodesk.AutoCAD.DatabaseServices import OpenMode, SymbolUtilityServices
from Autodesk.Civil.ApplicationServices import CivilDocument

adoc = Application.DocumentManager.MdiActiveDocument
db = adoc.Database
civdoc = CivilDocument.GetCivilDocument(db)

def oid_s(oid):
    try:
        if oid is None or oid.IsNull:
            return "Null"
        return oid.Handle.ToString()
    except Exception:
        return str(oid)

def safe(obj, attr):
    try:
        if hasattr(obj, attr):
            v = getattr(obj, attr)
            if hasattr(v, "X") and hasattr(v, "Y"):
                return (round(v.X, 3), round(v.Y, 3), round(getattr(v, "Z", 0.0), 3))
            if hasattr(v, "Handle"):
                return oid_s(v)
            return str(v)
    except Exception as e:
        return f"ERR:{type(e).__name__}:{e}"
    return None

def obj_name(tr, oid):
    try:
        if oid is None or oid.IsNull:
            return None
        o = tr.GetObject(oid, OpenMode.ForRead)
        return getattr(o, "Name", None)
    except Exception:
        return None

rep = {"profile_views": [], "pvparts": [], "labels": [], "errors": []}

with adoc.LockDocument():
    with db.TransactionManager.StartTransaction() as tr:
        try:
            # 1) List relevant profile views.
            pvid_by_handle = {}
            for aid in civdoc.GetAlignmentIds():
                aln = tr.GetObject(aid, OpenMode.ForRead)
                try:
                    pv_ids = list(aln.GetProfileViewIds())
                except Exception:
                    pv_ids = []
                for pvid in pv_ids:
                    pv = tr.GetObject(pvid, OpenMode.ForRead)
                    if "PIPE-10" in pv.Name or "PIPE-10" in aln.Name:
                        h = oid_s(pvid)
                        pvid_by_handle[h] = pvid
                        rep["profile_views"].append({
                            "alignment": aln.Name,
                            "pv": pv.Name,
                            "pv_handle": h,
                            "location": safe(pv, "Location"),
                            "elev_min": safe(pv, "ElevationMin"),
                            "elev_max": safe(pv, "ElevationMax"),
                        })

            # 2) Scan ModelSpace for PV parts and label-like objects.
            ms_id = SymbolUtilityServices.GetBlockModelSpaceId(db)
            ms = tr.GetObject(ms_id, OpenMode.ForRead)

            for eid in ms:
                try:
                    ent = tr.GetObject(eid, OpenMode.ForRead)
                    typ = ent.GetType().Name
                    typ_full = ent.GetType().FullName

                    is_pvpart = "ProfileViewPart" in typ or "ProfileViewPressurePart" in typ
                    is_label = "Label" in typ

                    if not (is_pvpart or is_label):
                        continue

                    row = {
                        "handle": oid_s(eid),
                        "type": typ,
                        "full": typ_full,
                        "location": safe(ent, "Location"),
                        "label_location": safe(ent, "LabelLocation"),
                        "position": safe(ent, "Position"),
                        "profile_view_id": safe(ent, "ProfileViewId"),
                        "model_part_id": safe(ent, "ModelPartId"),
                        "part_id": safe(ent, "PartId"),
                        "style_id": safe(ent, "StyleId"),
                        "style_name": safe(ent, "StyleName"),
                    }

                    # If it references a PV, add PV name.
                    for key in ("ProfileViewId",):
                        try:
                            if hasattr(ent, key):
                                pvid = getattr(ent, key)
                                row["profile_view_name"] = obj_name(tr, pvid)
                        except Exception:
                            pass

                    # Only keep all PV parts, but restrict labels a bit if possible.
                    if is_pvpart:
                        rep["pvparts"].append(row)
                    elif is_label:
                        # Keep label rows if they reference a PIPE-10 PV, or if location is suspiciously near/under profile area.
                        pvname = row.get("profile_view_name") or ""
                        if "PIPE-10" in pvname or len(rep["labels"]) < 80:
                            rep["labels"].append(row)

                except Exception as e:
                    rep["errors"].append(f"{oid_s(eid)}: {type(e).__name__}: {e}")

            tr.Abort()
        except Exception as e:
            rep["fatal"] = f"{type(e).__name__}: {e}"
            rep["trace"] = traceback.format_exc()
            tr.Abort()

OUT = rep
# ----------------------------------------
watch_12 = Watch(python_script_4)
string_5 = StringInput("\\wsl.localhost\Ubuntu-24.04\home\wsl\work\project\dynamo-python-node-docs-v1\data\20260720_crossings.ddb")
python_script_5 = Python(IN[0]=string_5)  # CPython3; frozen; unwired: IN[1]
# ---------- python_script_5.python (64 lines) ----------
# Open the pressure style's OwnerId -> is it a style collection? enumerate it. Compare to gravity coll. ABORT.
import clr
try: clr.AddReference("AeccPressurePipesMgd")
except Exception: pass
from Autodesk.AutoCAD.ApplicationServices import Application
from Autodesk.AutoCAD.DatabaseServices import OpenMode, SymbolUtilityServices
from Autodesk.Civil.ApplicationServices import CivilDocument
import Autodesk.Civil.DatabaseServices as cds
from Autodesk.AutoCAD.Runtime import RXClass

def style_name(o):
    return o.GetType().GetMethod("get_Name").Invoke(o, None)

log = []
adoc = Application.DocumentManager.MdiActiveDocument
db = adoc.Database
civdoc = CivilDocument.GetCivilDocument(db)
lock = adoc.LockDocument()
tr = db.TransactionManager.StartTransaction()
try:
    target = None
    for cand in ("CrossingPressurePipeProfileLabel", "PressurePartProfileLabel"):
        try: target = RXClass.GetClass(getattr(cds, cand)); break
        except Exception: pass
    ms = tr.GetObject(SymbolUtilityServices.GetBlockModelSpaceId(db), OpenMode.ForRead)
    owner_id = None; placed_names = set()
    if target:
        for oid in ms:
            try:
                if oid.ObjectClass.IsDerivedFrom(target):
                    lab = tr.GetObject(oid, OpenMode.ForRead)
                    sid = getattr(lab, "StyleId", None)
                    if sid is not None and not sid.IsNull:
                        st = tr.GetObject(sid, OpenMode.ForRead)
                        placed_names.add(style_name(st))
                        if owner_id is None:
                            owner_id = st.OwnerId
            except Exception: pass
    log.append(f"placed pressure style names: {sorted(placed_names)}")

    if owner_id is not None and not owner_id.IsNull:
        owner = tr.GetObject(owner_id, OpenMode.ForRead)
        log.append(f"OwnerId -> type {owner.GetType().FullName}")
        # try to enumerate it as a style collection
        try:
            ids = list(owner.ToObjectIds())
            names = [style_name(tr.GetObject(i, OpenMode.ForRead)) for i in ids]
            log.append(f"OwnerId collection ({len(names)}): {names}")
        except Exception as e:
            log.append(f"OwnerId.ToObjectIds ERR: {e}")

    # gravity collection for comparison
    gcoll = civdoc.Styles.LabelStyles.PipeLabelStyles.CrossProfileLabelStyles
    gids = list(gcoll.ToObjectIds())
    log.append(f"gravity CrossProfileLabelStyles ({len(gids)}): "
               f"{[style_name(tr.GetObject(i, OpenMode.ForRead)) for i in gids]}")
    log.append(f"OwnerId == gravity-coll ObjectId? {owner_id == gcoll.ObjectId if owner_id else 'n/a'}")
    tr.Abort()
except Exception as e:
    log.append(f"EXC {type(e).__name__}: {e}"); tr.Abort()
finally:
    tr.Dispose(); lock.Dispose()

OUT = log
# ----------------------------------------
watch_13 = Watch(python_script_5)

# group: Main
main_network = StringInput("1. YCC-WASTEWATER NETWORK")
suface_name = StringInput("LS and TR 100626")
duckdb_path_2 = StringInput("\\wsl.localhost\Ubuntu-24.04\home\wsl\work\project\dynamo-python-node-docs-v1\data\20260721_crossings.ddb")
aln_style_name = StringInput("Proposed")
aln_labelset_name = StringInput("_No Labels")
prof_style_name = StringInput("Existing Ground Profile")
prof_labelset_name = StringInput("_No Labels")
pv_style_name = StringInput("S22058-0400D-GRAVITY PROFILE VIEW")
bandset_name = StringInput("S22058-0400D-GRAVITY DTA BANDSET")
pv_parts_gravity_style_name_grav = StringInput("Pipe Crossing Pipe (Storm)")  # "PV Parts Gravity Style Name (grav_style_nm)"
pressure_pipe_name_to_copy_style_2 = StringInput("ME_Pressure Network_(490)")  # "Pressure Pipe Name to Copy Style From (pres_style_nm)"
grav_lblstyle_nm = CodeBlock { "LV CROSSING"; }
pres_lblstyle_nm = CodeBlock { "GAS CROSSING"; }
grav_map_csv = StringInput("\\wsl.localhost\Ubuntu-24.04\home\wsl\work\project\dynamo-python-node-docs-v1\data\templates\gravity_label_map.csv")
pres_map_csv = StringInput("\\wsl.localhost\Ubuntu-24.04\home\wsl\work\project\dynamo-python-node-docs-v1\data\templates\pressure_label_map.csv")
reload_tocken_2 = IntegerSlider(52, range=0..100 step 1)
python_script_6 = Python(IN[0]=main_network, IN[1]=suface_name, IN[2]=duckdb_path_2, IN[3]=aln_style_name, IN[4]=aln_labelset_name, IN[5]=prof_style_name, IN[6]=prof_labelset_name, IN[7]=pv_style_name, IN[8]=bandset_name, IN[9]=pv_parts_gravity_style_name_grav, IN[10]=pressure_pipe_name_to_copy_style_2, IN[11]=grav_lblstyle_nm, IN[12]=pres_lblstyle_nm, IN[13]=grav_map_csv, IN[14]=pres_map_csv, IN[15]=reload_tocken_2)  # CPython3
# ---------- python_script_6.python (50 lines) ----------
import sys, clr, importlib, traceback

clr.AddReference("AcMgd"); clr.AddReference("AcCoreMgd"); clr.AddReference("AcDbMgd")
clr.AddReference("AecBaseMgd"); clr.AddReference("AecPropDataMgd"); clr.AddReference("AeccDbMgd")
 
from Autodesk.AutoCAD.ApplicationServices.Core import Application
from Autodesk.Civil.ApplicationServices import CivilApplication

# --- repo path (edit to your clone) ---
REPO = r"\\wsl.localhost\Ubuntu-24.04\home\wsl\work\project\dynamo-python-node-docs-v1"
if REPO not in sys.path:
    sys.path.insert(0, REPO)
if f"{REPO}/Site-packages" not in sys.path:
    sys.path.append(f"{REPO}/Site-packages")

def unload_package(package_name):
    for name in list(sys.modules.keys()):
        if name == package_name or name.startswith(package_name + "."):
            del sys.modules[name]

# --- active document context ---
doc    = Application.DocumentManager.MdiActiveDocument
db     = doc.Database
ed     = doc.Editor
civdoc = CivilApplication.ActiveDocument

results = {"Success": False, "Warnings": [], "Errors": [], "Skipped": [], "Data": None}
RAISE_ON_ERROR = False

try:
    importlib.invalidate_caches()
    unload_package("automations")                                  # drop cached modules
    mod = importlib.import_module("automations.project_ic_profiles")

    with doc.LockDocument():
        with db.TransactionManager.StartTransaction() as tr:
            context = {"doc": doc, "db": db, "ed": ed,
                       "civdoc": civdoc, "tr": tr, "IN": IN}
            results["Data"] = mod.run(context)                     # module does the work
            tr.Commit()

    results["Success"] = True
    results["ModuleFile"] = getattr(mod, "__file__", None)         # confirms which file ran
except Exception as ex:
    results["Errors"].append(str(ex))
    results["Traceback"] = traceback.format_exc()
    if RAISE_ON_ERROR:
        raise

OUT = results
# ----------------------------------------
watch_14 = Watch(python_script_6)

code_block_8 = CodeBlock(x=watch_14) { x["Data"]["pv_handles"]; }
watch_15 = Watch(code_block_8)
shall_run_label_refresh = BoolSelector(false)
python_script_7 = Python(IN[0]=code_block_8, IN[1]=shall_run_label_refresh)  # CPython3
# ---------- python_script_7.python (43 lines) ----------
# Stage 8b: Re-fix profile view band items after Stage 8 has committed & datum settled.
# IN[0] = list of PV handles (strings) OR ObjectIds output by Stage 8.
import clr
from Autodesk.AutoCAD.ApplicationServices import Application
from Autodesk.AutoCAD.DatabaseServices import OpenMode, Handle
from Autodesk.Civil.ApplicationServices import CivilDocument

pv_handles = IN[0]   # e.g. ["1184FC", ...] — adapt to whatever Stage 8 actually returns

log = []
if IN[1]:
    adoc = Application.DocumentManager.MdiActiveDocument
    adoc.Editor.Regen()   # settle datum from Stage 8's committed parts before band round-trip
    db = adoc.Database
    lock = adoc.LockDocument()
    tr = db.TransactionManager.StartTransaction()
    try:
        fixed = 0
        for h in pv_handles:
            try:
                oid = db.GetObjectId(False, Handle(int(h, 16)), 0)
                pv = tr.GetObject(oid, OpenMode.ForWrite)
            except Exception as ex:
                log.append("skip {}: {}".format(h, ex))
                continue
            try:
                bottom = pv.Bands.GetBottomBandItems()
                pv.Bands.SetBottomBandItems(bottom)
                top = pv.Bands.GetTopBandItems()
                pv.Bands.SetTopBandItems(top)
                fixed += 1
            except Exception as ex:
                log.append("band fix failed for {}: {}".format(h, ex))
        tr.Commit()
        log.append("fixed {} of {} PVs".format(fixed, len(pv_handles)))
    except Exception as e:
        log.append("EXC: {}: {}".format(type(e).__name__, e))
        tr.Abort()
    finally:
        tr.Dispose()
        lock.Dispose()

OUT = log
# ----------------------------------------
watch_16 = Watch(python_script_7)

# group: Export PV Part Label Style Mapping Templates
duckdb_path_3 = StringInput("\\wsl.localhost\Ubuntu-24.04\home\wsl\work\project\dynamo-python-node-docs-v1\data\20260721_crossings.ddb")
out_dir = StringInput("\\wsl.localhost\Ubuntu-24.04\home\wsl\work\project\dynamo-python-node-docs-v1\data\templates")
reload_tocken_3 = IntegerSlider(16, range=0..100 step 1)
python_script_8 = Python(IN[0]=duckdb_path_3, IN[1]=out_dir, IN[2]=reload_tocken_3)  # CPython3; frozen
# ---------- python_script_8.python (87 lines) ----------
# Node A: Export description->style mapping templates + available-style pick-lists.
# IN[0] = duckdb_path, IN[1] = output directory for the CSVs.
import csv, os, clr
try:
    clr.AddReference("AeccPressurePipesMgd")
except Exception:
    pass
from Autodesk.AutoCAD.ApplicationServices import Application
from Autodesk.AutoCAD.DatabaseServices import OpenMode, SymbolUtilityServices
from Autodesk.Civil.ApplicationServices import CivilDocument
import Autodesk.Civil.DatabaseServices as cds
from Autodesk.AutoCAD.Runtime import RXClass
from automations import duckdb_engine as duck

duckdb_path = IN[0]
out_dir     = IN[1]

def style_name(o):
    """Read a style Name via CLR get_Name reflection (pythonnet .Name throws on this build)."""
    return o.GetType().GetMethod("get_Name").Invoke(o, None)

def write_csv(path, header, rows):
    with open(path, "w", newline="", encoding="utf-8-sig") as f:  # utf-8-sig => Excel + unicode (∅) safe
        w = csv.writer(f)
        w.writerow(header)
        for r in rows:
            w.writerow(r)

log = []
adoc = Application.DocumentManager.MdiActiveDocument
db = adoc.Database
civdoc = CivilDocument.GetCivilDocument(db)
con = duck.connect(duckdb_path)
lock = adoc.LockDocument()
tr = db.TransactionManager.StartTransaction()
try:
    # 1 & 2: distinct descriptions per role (NULL -> '' so the blank bucket is one row)
    for role, fname in (("gravity_cross", "gravity_label_map.csv"),
                        ("pressure_cross", "pressure_label_map.csv")):
        descs = con.execute(f"""SELECT DISTINCT COALESCE(description,'') AS d, COUNT(*) n
                                FROM pipes WHERE role=? GROUP BY 1 ORDER BY n DESC""",
                            [role]).fetchall()
        write_csv(os.path.join(out_dir, fname),
                  ["description", "label_style_name"],
                  [[d, ""] for d, _n in descs])
        log.append(f"{fname}: {len(descs)} descriptions")

    # 3: gravity available styles (collection + get_Name reflection)
    coll = civdoc.Styles.LabelStyles.PipeLabelStyles.CrossProfileLabelStyles
    gnames = [style_name(tr.GetObject(sid, OpenMode.ForRead)) for sid in coll.ToObjectIds()]
    write_csv(os.path.join(out_dir, "gravity_label_styles.csv"),
              ["available_gravity_label_style"], [[n] for n in gnames])
    log.append(f"gravity_label_styles.csv: {len(gnames)} styles")

    # 4: pressure available styles (BORROWABLE placed-label StyleNames only)
    target = None
    for cand in ("CrossingPressurePipeProfileLabel", "PressurePartProfileLabel"):
        try:
            target = RXClass.GetClass(getattr(cds, cand)); break
        except Exception:
            continue
    ms = tr.GetObject(SymbolUtilityServices.GetBlockModelSpaceId(db), OpenMode.ForRead)
    pnames = set()
    if target:
        for oid in ms:
            try:
                if oid.ObjectClass.IsDerivedFrom(target):
                    lab = tr.GetObject(oid, OpenMode.ForRead)
                    sn = getattr(lab, "StyleName", None)   # readable on placed labels (Probe 2)
                    if sn:
                        pnames.add(sn)
            except Exception:
                continue
    write_csv(os.path.join(out_dir, "pressure_label_styles.csv"),
              ["available_pressure_label_style (must be PLACED to be usable)"],
              [[n] for n in sorted(pnames)])
    log.append(f"pressure_label_styles.csv: {len(pnames)} borrowable styles "
               f"({'none placed yet' if not pnames else ''})")

    tr.Abort()
except Exception as e:
    log.append(f"EXC: {type(e).__name__}: {e}")
    tr.Abort()
finally:
    tr.Dispose(); lock.Dispose()

OUT = log
# ----------------------------------------
watch_17 = Watch(python_script_8)
