# Dynamo graph stage6_add_parts.dyn (Dynamo 3.3.1.7726)

# group: Main
duckdb_path = StringInput("\\wsl.localhost\Ubuntu-24.04\home\wsl\work\project\dynamo-python-node-docs-v1\data\stage3_crossings.ddb")
pv_parts_gravity_style_name = StringInput("Pipe Crossing Pipe (Storm)")
pressure_pipe_name_to_copy_style = StringInput("ME_Pressure Network_(490)")  # "Pressure Pipe Name to Copy Style From"
reload_tocken = IntegerSlider(32, range=0..100 step 1)
python_script = Python(IN[0]=duckdb_path, IN[1]=pv_parts_gravity_style_name, IN[2]=pressure_pipe_name_to_copy_style, IN[3]=reload_tocken)  # CPython3
# ---------- python_script.python (50 lines) ----------
import sys, clr, importlib, traceback

clr.AddReference("AcMgd"); clr.AddReference("AcCoreMgd"); clr.AddReference("AcDbMgd")
clr.AddReference("AecBaseMgd"); clr.AddReference("AecPropDataMgd"); clr.AddReference("AeccDbMgd")
 
from Autodesk.AutoCAD.ApplicationServices.Core import Application
from Autodesk.Civil.ApplicationServices import CivilApplication

# --- repo path (edit to your clone) ---
REPO = r"\\wsl.localhost\Ubuntu-24.04\home\wsl\work\project\dynamo-python-node-docs-v1"
if REPO not in sys.path:
    sys.path.insert(0, REPO)
if f"{REPO}/Site-packages" not in sys.path:
    sys.path.append(f"{REPO}/Site-packages")

def unload_package(package_name):
    for name in list(sys.modules.keys()):
        if name == package_name or name.startswith(package_name + "."):
            del sys.modules[name]

# --- active document context ---
doc    = Application.DocumentManager.MdiActiveDocument
db     = doc.Database
ed     = doc.Editor
civdoc = CivilApplication.ActiveDocument

results = {"Success": False, "Warnings": [], "Errors": [], "Skipped": [], "Data": None}
RAISE_ON_ERROR = False

try:
    importlib.invalidate_caches()
    unload_package("automations")                                  # drop cached modules
    mod = importlib.import_module("automations.stage6_add_parts")

    with doc.LockDocument():
        with db.TransactionManager.StartTransaction() as tr:
            context = {"doc": doc, "db": db, "ed": ed,
                       "civdoc": civdoc, "tr": tr, "IN": IN}
            results["Data"] = mod.run(context)                     # module does the work
            tr.Commit()

    results["Success"] = True
    results["ModuleFile"] = getattr(mod, "__file__", None)         # confirms which file ran
except Exception as ex:
    results["Errors"].append(str(ex))
    results["Traceback"] = traceback.format_exc()
    if RAISE_ON_ERROR:
        raise

OUT = results
# ----------------------------------------
watch = Watch(python_script)
string = StringInput("Combined Paste")

# group: Test one crossing in modelspace
code_block = CodeBlock { x["Data"]["Crossings"][4792]; }  # frozen; unwired: x
watch_2 = Watch(code_block)
code_block_2 = CodeBlock(x=code_block) { x[7]; x[8]; x[9]; }
byCoordinates = Point.ByCoordinates(x=code_block_2.out0, y=code_block_2.out1, z=code_block_2.out2)
watch_3 = Watch(byCoordinates)
integer_slider = IntegerSlider(63, range=0..100 step 1)
byCenterPointRadius = Circle.ByCenterPointRadius(centerPoint=byCoordinates, radius=integer_slider)
watch_4 = Watch(byCenterPointRadius)
string_2 = StringInput("Testing")
byGeometry = Autodesk.AutoCAD.DynamoNodes.Object.ByGeometry(geometry=byCoordinates, layerName=string_2)
watch_5 = Watch(byGeometry)
string_3 = StringInput("Testing")
byGeometry_2 = Autodesk.AutoCAD.DynamoNodes.Object.ByGeometry(geometry=byCenterPointRadius, layerName=string_3)
watch_6 = Watch(byGeometry_2)

python_script_2 = Python()  # CPython3; frozen; unwired: IN[0]
# ---------- python_script_2.python (54 lines) ----------
# Find the PressurePipeStyle collection. OUT = report
import clr
clr.AddReference("AcMgd"); clr.AddReference("AcDbMgd"); clr.AddReference("AeccDbMgd")
clr.AddReference("AeccPressurePipesMgd")
from Autodesk.AutoCAD.ApplicationServices.Core import Application
from Autodesk.AutoCAD.DatabaseServices import OpenMode
from Autodesk.Civil.ApplicationServices import CivilApplication, CivilDocumentPressurePipesExtension
civdoc = CivilApplication.ActiveDocument
db = Application.DocumentManager.MdiActiveDocument.Database
report = []
def log(x): report.append(str(x))

# (1) full recursive-ish walk of civdoc.Styles for ANY collection whose ToObjectIds
#     yields a PressurePipeStyle, one level under each *Styles collection too
tr = db.TransactionManager.StartTransaction()
try:
    nids = list(CivilDocumentPressurePipesExtension.GetPressurePipeNetworkIds(civdoc))
    pp = None
    for nid in nids:
        pids = list(tr.GetObject(nid, OpenMode.ForRead).GetPipeIds())
        if pids: pp = tr.GetObject(pids[0], OpenMode.ForRead); break
    target = str(pp.get_StyleId())
    log(f"target = {target}")

    styles = civdoc.Styles
    roots = [n for n in dir(styles) if n.endswith("Styles") and not n.startswith("get_")]
    for cn in roots:
        coll = getattr(styles, cn, None)
        # try the collection itself
        try:
            oids = list(coll.ToObjectIds())
            if any(str(o)==target for o in oids):
                log(f">>> target in civdoc.Styles.{cn}")
            # peek element type
            if oids:
                t = type(tr.GetObject(oids[0], OpenMode.ForRead)).__name__
                if "Pressure" in t:
                    log(f"civdoc.Styles.{cn} holds {t} (Count={len(oids)})")
        except Exception:
            pass
        # try nested sub-collections one level down
        for sub in [s for s in dir(coll) if s.endswith("Styles") and not s.startswith("get_")]:
            try:
                subcoll = getattr(coll, sub)
                oids = list(subcoll.ToObjectIds())
                if any(str(o)==target for o in oids):
                    log(f">>> target in civdoc.Styles.{cn}.{sub}")
                if oids and "Pressure" in type(tr.GetObject(oids[0], OpenMode.ForRead)).__name__:
                    log(f"civdoc.Styles.{cn}.{sub} holds PressurePipeStyle (Count={len(oids)})")
            except Exception:
                pass
finally:
    tr.Dispose()
OUT = report
# ----------------------------------------
watch_7 = Watch(python_script_2)
