# Dynamo graph stage7_labels_w_handoff.dyn (Dynamo 3.3.1.7726)

# group: Main
string = StringInput("Combined Paste")
duckdb_path = StringInput("\\wsl.localhost\Ubuntu-24.04\home\wsl\work\project\dynamo-python-node-docs-v1\data\stage3_crossings.ddb")
pv_parts_gravity_style_name = StringInput("Pipe Crossing Pipe (Storm)")
pressure_pipe_name_to_copy_style = StringInput("ME_Pressure Network_(490)")  # "Pressure Pipe Name to Copy Style From"
reload_tocken = IntegerSlider(35, range=0..100 step 1)
python_script = Python(IN[0]=duckdb_path, IN[1]=pv_parts_gravity_style_name, IN[2]=pressure_pipe_name_to_copy_style, IN[3]=reload_tocken)  # CPython3
# ---------- python_script.python (50 lines) ----------
import sys, clr, importlib, traceback

clr.AddReference("AcMgd"); clr.AddReference("AcCoreMgd"); clr.AddReference("AcDbMgd")
clr.AddReference("AecBaseMgd"); clr.AddReference("AecPropDataMgd"); clr.AddReference("AeccDbMgd")
 
from Autodesk.AutoCAD.ApplicationServices.Core import Application
from Autodesk.Civil.ApplicationServices import CivilApplication

# --- repo path (edit to your clone) ---
REPO = r"\\wsl.localhost\Ubuntu-24.04\home\wsl\work\project\dynamo-python-node-docs-v1"
if REPO not in sys.path:
    sys.path.insert(0, REPO)
if f"{REPO}/Site-packages" not in sys.path:
    sys.path.append(f"{REPO}/Site-packages")

def unload_package(package_name):
    for name in list(sys.modules.keys()):
        if name == package_name or name.startswith(package_name + "."):
            del sys.modules[name]

# --- active document context ---
doc    = Application.DocumentManager.MdiActiveDocument
db     = doc.Database
ed     = doc.Editor
civdoc = CivilApplication.ActiveDocument

results = {"Success": False, "Warnings": [], "Errors": [], "Skipped": [], "Data": None}
RAISE_ON_ERROR = False

try:
    importlib.invalidate_caches()
    unload_package("automations")                                  # drop cached modules
    mod = importlib.import_module("automations.stage6_add_parts")

    with doc.LockDocument():
        with db.TransactionManager.StartTransaction() as tr:
            context = {"doc": doc, "db": db, "ed": ed,
                       "civdoc": civdoc, "tr": tr, "IN": IN}
            results["Data"] = mod.run(context)                     # module does the work
            tr.Commit()

    results["Success"] = True
    results["ModuleFile"] = getattr(mod, "__file__", None)         # confirms which file ran
except Exception as ex:
    results["Errors"].append(str(ex))
    results["Traceback"] = traceback.format_exc()
    if RAISE_ON_ERROR:
        raise

OUT = results
# ----------------------------------------
watch = Watch(python_script)

python_script_2 = Python()  # CPython3; frozen; unwired: IN[0]
# ---------- python_script_2.python (54 lines) ----------
# Find the PressurePipeStyle collection. OUT = report
import clr
clr.AddReference("AcMgd"); clr.AddReference("AcDbMgd"); clr.AddReference("AeccDbMgd")
clr.AddReference("AeccPressurePipesMgd")
from Autodesk.AutoCAD.ApplicationServices.Core import Application
from Autodesk.AutoCAD.DatabaseServices import OpenMode
from Autodesk.Civil.ApplicationServices import CivilApplication, CivilDocumentPressurePipesExtension
civdoc = CivilApplication.ActiveDocument
db = Application.DocumentManager.MdiActiveDocument.Database
report = []
def log(x): report.append(str(x))

# (1) full recursive-ish walk of civdoc.Styles for ANY collection whose ToObjectIds
#     yields a PressurePipeStyle, one level under each *Styles collection too
tr = db.TransactionManager.StartTransaction()
try:
    nids = list(CivilDocumentPressurePipesExtension.GetPressurePipeNetworkIds(civdoc))
    pp = None
    for nid in nids:
        pids = list(tr.GetObject(nid, OpenMode.ForRead).GetPipeIds())
        if pids: pp = tr.GetObject(pids[0], OpenMode.ForRead); break
    target = str(pp.get_StyleId())
    log(f"target = {target}")

    styles = civdoc.Styles
    roots = [n for n in dir(styles) if n.endswith("Styles") and not n.startswith("get_")]
    for cn in roots:
        coll = getattr(styles, cn, None)
        # try the collection itself
        try:
            oids = list(coll.ToObjectIds())
            if any(str(o)==target for o in oids):
                log(f">>> target in civdoc.Styles.{cn}")
            # peek element type
            if oids:
                t = type(tr.GetObject(oids[0], OpenMode.ForRead)).__name__
                if "Pressure" in t:
                    log(f"civdoc.Styles.{cn} holds {t} (Count={len(oids)})")
        except Exception:
            pass
        # try nested sub-collections one level down
        for sub in [s for s in dir(coll) if s.endswith("Styles") and not s.startswith("get_")]:
            try:
                subcoll = getattr(coll, sub)
                oids = list(subcoll.ToObjectIds())
                if any(str(o)==target for o in oids):
                    log(f">>> target in civdoc.Styles.{cn}.{sub}")
                if oids and "Pressure" in type(tr.GetObject(oids[0], OpenMode.ForRead)).__name__:
                    log(f"civdoc.Styles.{cn}.{sub} holds PressurePipeStyle (Count={len(oids)})")
            except Exception:
                pass
finally:
    tr.Dispose()
OUT = report
# ----------------------------------------
watch_2 = Watch(python_script_2)
code_block = CodeBlock(x=watch) { x["Data"]["Handoff"]; }
watch_3 = Watch(code_block)
code_block_2 = CodeBlock { "LV CROSSING"; }
code_block_3 = CodeBlock { "WATER CROSSING"; }
integer_slider = IntegerSlider(52, range=0..100 step 1)
python_script_3 = Python(IN[0]=duckdb_path, IN[1]=code_block_2, IN[2]=code_block_3, IN[3]=code_block, IN[4]=integer_slider)  # CPython3
# ---------- python_script_3.python (50 lines) ----------
import sys, clr, importlib, traceback

clr.AddReference("AcMgd"); clr.AddReference("AcCoreMgd"); clr.AddReference("AcDbMgd")
clr.AddReference("AecBaseMgd"); clr.AddReference("AecPropDataMgd"); clr.AddReference("AeccDbMgd")
 
from Autodesk.AutoCAD.ApplicationServices.Core import Application
from Autodesk.Civil.ApplicationServices import CivilApplication

# --- repo path (edit to your clone) ---
REPO = r"\\wsl.localhost\Ubuntu-24.04\home\wsl\work\project\dynamo-python-node-docs-v1"
if REPO not in sys.path:
    sys.path.insert(0, REPO)
if f"{REPO}/Site-packages" not in sys.path:
    sys.path.append(f"{REPO}/Site-packages")

def unload_package(package_name):
    for name in list(sys.modules.keys()):
        if name == package_name or name.startswith(package_name + "."):
            del sys.modules[name]

# --- active document context ---
doc    = Application.DocumentManager.MdiActiveDocument
db     = doc.Database
ed     = doc.Editor
civdoc = CivilApplication.ActiveDocument

results = {"Success": False, "Warnings": [], "Errors": [], "Skipped": [], "Data": None}
RAISE_ON_ERROR = False

try:
    importlib.invalidate_caches()
    unload_package("automations")                                  # drop cached modules
    mod = importlib.import_module("automations.stage7_labels")

    with doc.LockDocument():
        with db.TransactionManager.StartTransaction() as tr:
            context = {"doc": doc, "db": db, "ed": ed,
                       "civdoc": civdoc, "tr": tr, "IN": IN}
            results["Data"] = mod.run(context)                     # module does the work
            tr.Commit()

    results["Success"] = True
    results["ModuleFile"] = getattr(mod, "__file__", None)         # confirms which file ran
except Exception as ex:
    results["Errors"].append(str(ex))
    results["Traceback"] = traceback.format_exc()
    if RAISE_ON_ERROR:
        raise

OUT = results
# ----------------------------------------
watch_4 = Watch(python_script_3)

# group: Test one crossing in modelspace
code_block_4 = CodeBlock { x["Data"]["Crossings"][4792]; }  # frozen; unwired: x
watch_5 = Watch(code_block_4)
code_block_5 = CodeBlock(x=code_block_4) { x[7]; x[8]; x[9]; }
byCoordinates = Point.ByCoordinates(x=code_block_5.out0, y=code_block_5.out1, z=code_block_5.out2)
watch_6 = Watch(byCoordinates)
integer_slider_2 = IntegerSlider(63, range=0..100 step 1)
byCenterPointRadius = Circle.ByCenterPointRadius(centerPoint=byCoordinates, radius=integer_slider_2)
watch_7 = Watch(byCenterPointRadius)
string_2 = StringInput("Testing")
byGeometry = Autodesk.AutoCAD.DynamoNodes.Object.ByGeometry(geometry=byCoordinates, layerName=string_2)
watch_8 = Watch(byGeometry)
string_3 = StringInput("Testing")
byGeometry_2 = Autodesk.AutoCAD.DynamoNodes.Object.ByGeometry(geometry=byCenterPointRadius, layerName=string_3)
watch_9 = Watch(byGeometry_2)
code_block_6 = CodeBlock(x=watch_4) { x["Data"]["Warnings"]; }

code_block_7 = CodeBlock(x=watch_4) { x["Data"]["Warnings"]; }
watch_10 = Watch(code_block_7)
watch_11 = Watch(code_block_6)
code_block_8 = CodeBlock { "YCC- WASTEWATER NETWORK"; }
python_script_4 = Python()  # CPython3; unwired: IN[0]
# ---------- python_script_4.python (59 lines) ----------
# PROBE — determine a VALID pressure crossing label StyleId.
# Uses ONE real pressure pvpart from your handoff. read-mostly; creates one label
# WITHOUT a style arg if an overload allows, else inspects DefaultLabelStyle sources.
import clr
clr.AddReference('AeccDbMgd'); clr.AddReference('AcDbMgd'); clr.AddReference('AcMgd')
from Autodesk.AutoCAD.ApplicationServices import Application
from Autodesk.AutoCAD.DatabaseServices import OpenMode, Handle, ObjectId
from Autodesk.Civil.ApplicationServices import CivilApplication
import Autodesk.Civil.DatabaseServices as cds
from Autodesk.AutoCAD.Runtime import RXClass

adoc = Application.DocumentManager.MdiActiveDocument
db = adoc.Database
civdoc = CivilApplication.ActiveDocument
out = {}

# 1) List Create overloads for CrossingPressurePipeProfileLabel — is there a
#    signature WITHOUT a style id?
try:
    m = cds.CrossingPressurePipeProfileLabel.Create
    out["Create_overloads"] = str(m.Overloads)
except Exception as e:
    out["Create_overloads"] = f"ERR {e}"

# 2) Is there any existing PressurePartProfileLabel / crossing label in the drawing
#    whose StyleId we can borrow? Scan ModelSpace for that RXClass.
from Autodesk.AutoCAD.DatabaseServices import BlockTableRecord, SymbolUtilityServices
found_style = None
with adoc.LockDocument():
    with db.TransactionManager.StartTransaction() as tr:
        ms = tr.GetObject(SymbolUtilityServices.GetBlockModelSpaceId(db), OpenMode.ForRead)
        target = None
        for cand in ("CrossingPressurePipeProfileLabel", "PressurePartProfileLabel"):
            try:
                target = RXClass.GetClass(getattr(cds, cand)); break
            except Exception:
                continue
        cnt = 0
        for oid in ms:
            try:
                if oid.ObjectClass.IsDerivedFrom(target):
                    lab = tr.GetObject(oid, OpenMode.ForRead)
                    found_style = (lab.StyleName, str(lab.StyleId), lab.StyleId.IsNull)
                    cnt += 1
                    if cnt >= 1: break
            except Exception:
                pass
        out["existing_label_count"] = cnt
        out["borrowed_style"] = found_style

# 3) What does PipeLabelStyles.CrossProfileLabelStyles.DefaultLabelStyle give,
#    and is it the SAME thing that failed? (sanity)
try:
    d = civdoc.Styles.LabelStyles.PipeLabelStyles.CrossProfileLabelStyles.DefaultLabelStyle
    out["gravity_default_style"] = (str(d), d.IsNull)
except Exception as e:
    out["gravity_default_style"] = f"ERR {e}"

OUT = out
# ----------------------------------------
watch_12 = Watch(python_script_4)
