# Dynamo graph ex00_hello.dyn (Dynamo 3.3.1.7726)

reload_token = CodeBlock { "Barane"; "run 3"; }
python_script = Python(IN[0]=reload_token.out0, IN[1]=reload_token.out1)  # CPython3
# ---------- python_script.python (13 lines) ----------
import sys, importlib

# 1. put your repo on the path (edit to your clone location)
REPO = r"\\wsl.localhost\Ubuntu-24.04\home\wsl\work\project\dynamo-python-node-docs-v1"
if REPO not in sys.path:
    sys.path.append(REPO)

# 2. import and FORCE-RELOAD the module so file edits are picked up every run
import exercises.ex00_hello as mod
importlib.reload(mod)                 # <-- the magic that avoids copy-paste

# 3. hand Dynamo's inputs to your function, return its result
OUT = mod.run(IN)
# ----------------------------------------
watch = Watch(python_script)  # graph output
reload_token_2 = CodeBlock { "Barane"; "run 3"; }
python_script_2 = Python(IN[0]=reload_token_2.out0, IN[1]=reload_token_2.out1)  # CPython3; same code as python_script
watch_2 = Watch(python_script_2)  # graph output
