# Dynamo graph ex03_write.dyn (Dynamo 3.3.1.7726)

run_token = IntegerSlider(58, range=0..100 step 1)
python_script = Python(IN[0]=run_token)  # CPython3
# ---------- python_script.python (49 lines) ----------
import sys, clr, importlib, traceback

clr.AddReference("AcMgd"); clr.AddReference("AcCoreMgd"); clr.AddReference("AcDbMgd")
clr.AddReference("AecBaseMgd"); clr.AddReference("AecPropDataMgd"); clr.AddReference("AeccDbMgd")

from Autodesk.AutoCAD.ApplicationServices.Core import Application
from Autodesk.Civil.ApplicationServices import CivilApplication

# --- repo path (edit to your clone) ---
REPO = r"\\wsl.localhost\Ubuntu-24.04\home\wsl\work\project\dynamo-python-node-docs-v1"
if REPO not in sys.path:
    sys.path.insert(0, REPO)

# --- force-reload the WHOLE package so nested helper edits are picked up ---
def unload_package(package_name):
    for name in list(sys.modules.keys()):
        if name == package_name or name.startswith(package_name + "."):
            del sys.modules[name]

# --- active document context ---
doc    = Application.DocumentManager.MdiActiveDocument
db     = doc.Database
ed     = doc.Editor
civdoc = CivilApplication.ActiveDocument

results = {"Success": False, "Warnings": [], "Errors": [], "Skipped": [], "Data": None}
RAISE_ON_ERROR = True

try:
    importlib.invalidate_caches()
    unload_package("exercises")                                  # drop cached modules
    mod = importlib.import_module("exercises.ex03_write")

    with doc.LockDocument():
        with db.TransactionManager.StartTransaction() as tr:
            context = {"doc": doc, "db": db, "ed": ed,
                       "civdoc": civdoc, "tr": tr, "IN": IN}
            results["Data"] = mod.run(context)                     # module does the work
            tr.Commit()

    results["Success"] = True
    results["ModuleFile"] = getattr(mod, "__file__", None)         # confirms which file ran
except Exception as ex:
    results["Errors"].append(str(ex))
    results["Traceback"] = traceback.format_exc()
    if RAISE_ON_ERROR:
        raise

OUT = results
# ----------------------------------------
watch = Watch(python_script)  # graph output
python_script_2 = Python(IN[0]=run_token)  # CPython3; frozen
# ---------- python_script_2.python (58 lines) ----------
import clr, traceback

clr.AddReference("AcMgd")
clr.AddReference("AcCoreMgd")
clr.AddReference("AcDbMgd")
clr.AddReference("AecBaseMgd")           # Autodesk.Aec base (property data, etc.)
clr.AddReference("AecPropDataMgd")
clr.AddReference("AeccDbMgd")            # Civil 3D database objects

from Autodesk.AutoCAD.ApplicationServices.Core import Application
from Autodesk.Civil.ApplicationServices import CivilApplication
from Autodesk.AutoCAD.DatabaseServices import (
     OpenMode, ObjectId, Polyline, SymbolUtilityServices, LayerTable, LayerTableRecord)
from Autodesk.AutoCAD.Geometry import Point2d, Point3d
from Autodesk.Civil.DatabaseServices import Alignment, PolylineOptions
from Autodesk.AutoCAD.Colors import Color, ColorMethod

# active document context
doc    = Application.DocumentManager.MdiActiveDocument
db     = doc.Database
ed     = doc.Editor
civdoc = CivilApplication.ActiveDocument

results = {"Success": False, "Warnings": [], "Errors": [], "Skipped": [], "Data": None}
RAISE_ON_ERROR = False        # True while developing → Dynamo fails loudly

def _ensure_layer(tr, db, name):
    lt = tr.GetObject(db.LayerTableId, OpenMode.ForRead)
    if lt.Has(name): 
        return True
    lt = tr.GetObject(db.LayerTableId, OpenMode.ForWrite)
    rec = LayerTableRecord(); rec.Name = name
    lid = lt.Add(rec); tr.AddNewlyCreatedDBObject(rec, True)
    return lid


try:
    with doc.LockDocument():             
        with db.TransactionManager.StartTransaction() as tr:
            _ensure_layer(tr, db, "DEV-SCRATCH")
            ms = tr.GetObject(SymbolUtilityServices.GetBlockModelSpaceId(db), OpenMode.ForWrite)
            pl = Polyline()
            pl.AddVertexAt(0, Point2d(0.0, 0.0),  0.0, 0.0, 0.0)
            pl.AddVertexAt(1, Point2d(50.0, 20.0), 0.0, 0.0, 0.0)
            pl.Layer = "DEV-SCRATCH"
            pid = ms.AppendEntity(pl)
            tr.AddNewlyCreatedDBObject(pl, True)      
            tr.Commit()
            results["Data"] = {"Created": str(pid)}                       
            #results["Data"] = "Prathamesh"
    results["Success"] = True
except Exception as ex:
    results["Errors"].append(str(ex))
    results["Traceback"] = traceback.format_exc()
    if RAISE_ON_ERROR:
        raise

OUT = results
# ----------------------------------------
watch_2 = Watch(python_script_2)
