# Dynamo graph ex07_out_param.dyn (Dynamo 3.3.1.7726)

code_block = CodeBlock { 1.1; 0.2; }
reload_token = IntegerSlider(30, range=0..100 step 1)
python_script = Python(IN[0]=code_block.out0, IN[1]=code_block.out1, IN[2]=reload_token)  # CPython3
# ---------- python_script.python (49 lines) ----------
import sys, clr, importlib, traceback

clr.AddReference("AcMgd"); clr.AddReference("AcCoreMgd"); clr.AddReference("AcDbMgd")
clr.AddReference("AecBaseMgd"); clr.AddReference("AecPropDataMgd"); clr.AddReference("AeccDbMgd")

from Autodesk.AutoCAD.ApplicationServices.Core import Application
from Autodesk.Civil.ApplicationServices import CivilApplication

# --- repo path (edit to your clone) ---
REPO = r"\\wsl.localhost\Ubuntu-24.04\home\wsl\work\project\dynamo-python-node-docs-v1"
if REPO not in sys.path:
    sys.path.insert(0, REPO)

# --- force-reload the WHOLE package so nested helper edits are picked up ---
def unload_package(package_name):
    for name in list(sys.modules.keys()):
        if name == package_name or name.startswith(package_name + "."):
            del sys.modules[name]

# --- active document context ---
doc    = Application.DocumentManager.MdiActiveDocument
db     = doc.Database
ed     = doc.Editor
civdoc = CivilApplication.ActiveDocument

results = {"Success": False, "Warnings": [], "Errors": [], "Skipped": [], "Data": None}
RAISE_ON_ERROR = False

try:
    importlib.invalidate_caches()
    unload_package("exercises")                                  # drop cached modules
    mod = importlib.import_module("exercises.ex07_out_param")

    with doc.LockDocument():
        with db.TransactionManager.StartTransaction() as tr:
            context = {"doc": doc, "db": db, "ed": ed,
                       "civdoc": civdoc, "tr": tr, "IN": IN}
            results["Data"] = mod.run(context)                     # module does the work
            tr.Commit()

    results["Success"] = True
    results["ModuleFile"] = getattr(mod, "__file__", None)         # confirms which file ran
except Exception as ex:
    results["Errors"].append(str(ex))
    results["Traceback"] = traceback.format_exc()
    if RAISE_ON_ERROR:
        raise

OUT = results
# ----------------------------------------
watch = Watch(python_script)
